# Dynamo custom node Get Curtain Wall Types.dyf (Dynamo 1.3.4.6666)
# category: Dino.Elements.Walls
# Retrieves curtain wall types

python_script = Python()  # unwired: IN[0]
# ---------- python_script.python (11 lines) ----------
import sys

sys.path.append('C:/ProgramData/Dynamo/Dynamo Revit/1.3/definitions/dino/')

from dino_core import get_curtain_wall_types

#The inputs to this node will be stored as a list in the IN variables.
category = UnwrapElement(IN[0])

#Assign your output to the OUT variable.
OUT = get_curtain_wall_types()
# ----------------------------------------
WallType = Output(python_script)  # "WallType[]"
