# Dynamo custom node Get Element Names.dyf (Dynamo 1.3.4.6666)
# category: Dino.Elements
# Retrieves the element names

Element = Input()  # "Element[]"
python_script = Python(IN[0]=Element)
# ---------- python_script.python (12 lines) ----------
import clr
import sys

sys.path.append('C:/ProgramData/Dynamo/Dynamo Revit/1.3/definitions/dino/')
from dino_core import get_element_names

#The inputs to this node will be stored as a list in the IN variables.
elements = UnwrapElement(IN[0])

#Assign your output to the OUT variable.
OUT = get_element_names(elements)
      
# ----------------------------------------
string = Output(python_script)  # "string[]"
