# Dynamo custom node Get Elements.dyf (Dynamo 1.3.4.6666)
# category: Dino.Elements
# Retrieves the elements by category

Category = Input()
python_script = Python(IN[0]=Category)
# ---------- python_script.python (11 lines) ----------
import sys

sys.path.append('C:/ProgramData/Dynamo/Dynamo Revit/1.3/definitions/dino/')

from dino_core import get_elements

#The inputs to this node will be stored as a list in the IN variables.
category = UnwrapElement(IN[0])

#Assign your output to the OUT variable.
OUT = get_elements(category)
# ----------------------------------------
Element = Output(python_script)  # "Element[]"
