# Dynamo custom node Get Family Symbols.dyf (Dynamo 1.3.4.6666)
# category: Dino.Elements
# Retrieves the family symbols by category

Category = Input()
python_script = Python(IN[0]=Category)
# ---------- python_script.python (12 lines) ----------
import clr
import sys

sys.path.append('C:/ProgramData/Dynamo/Dynamo Revit/1.3/definitions/dino/')

from dino_core import get_family_symbols

#The inputs to this node will be stored as a list in the IN variables.
category = UnwrapElement(IN[0])

#Assign your output to the OUT variable.
OUT = get_family_symbols(category)
# ----------------------------------------
FamilyType = Output(python_script)  # "FamilyType[]"
