# Dynamo custom node COBie Date.dyf "Date" (Dynamo 1.3.4.6666)
# category: Dino.Data.COBie
# Generates date time data in COBie format

python_script = Python()  # unwired: IN[0]
# ---------- python_script.python (12 lines) ----------
import clr
import sys

sys.path.append('C:/ProgramData/Dynamo/Dynamo Revit/1.3/definitions/dino/')

from dino_core import created_at

#The inputs to this node will be stored as a list in the IN variables.
dataEnteringNode = IN

#Assign your output to the OUT variable.
OUT = created_at()
# ----------------------------------------
date = Output(python_script)  # "date: string"
