# Dynamo custom node Generate Keys.dyf (Dynamo 1.3.4.6666)
# category: Dino.Data
# Generates a list of keys

data = Input(data: var[])
key = Input(key: string)
separator = Input(separator: string)
python_script = Python(IN[0]=data, IN[1]=key, IN[2]=separator)
# ---------- python_script.python (15 lines) ----------
import clr
import sys

sys.path.append('C:/ProgramData/Dynamo/Dynamo Revit/1.3/definitions/dino/')

from dino_core import generate_keys

#The inputs to this node will be stored as a list in the IN variables.
data = UnwrapElement(IN[0])
key = UnwrapElement(IN[1])
separator = UnwrapElement(IN[2])

#Assign your output to the OUT variable.
OUT = generate_keys(data, key, separator)
      
# ----------------------------------------
data_2 = Output(python_script)  # "data: var[]"
