# Dynamo custom node Join Data.dyf (Dynamo 1.3.4.6666)
# category: Dino.Data
# Concatenates the two sets of data

data1 = Input(data1: var[])
data2 = Input(data2: var[])
separator = Input(separator: string)
python_script = Python(IN[0]=data1, IN[1]=data2, IN[2]=separator)
# ---------- python_script.python (16 lines) ----------
import clr
import sys

sys.path.append('C:/ProgramData/Dynamo/Dynamo Revit/1.3/definitions/dino/')


from dino_core import join_data

#The inputs to this node will be stored as a list in the IN variables.
input1 = UnwrapElement(IN[0])
input2 = UnwrapElement(IN[1])
input3 = UnwrapElement(IN[2])

#Assign your output to the OUT variable.
OUT = join_data(input1, input2, input3)
      
# ----------------------------------------
data = Output(python_script)  # "data: string[]"
