# Dynamo custom node Numerize.dyf (Dynamo 1.3.4.6666)
# category: Dino.Data
# Generates series of numbers

data = Input(data: var[])
python_script = Python(IN[0]=data)
# ---------- python_script.python (13 lines) ----------
import clr
import sys

sys.path.append('C:/ProgramData/Dynamo/Dynamo Revit/1.3/definitions/dino/')

from dino_core import numerize

#The inputs to this node will be stored as a list in the IN variables.
data = UnwrapElement(IN[0])

#Assign your output to the OUT variable.
OUT = numerize(data)
      
# ----------------------------------------
data_2 = Output(python_script)  # "data: var[]"
