# Dynamo custom node Filter Elements by Category.dyf (Dynamo 1.3.4.6666)
# category: Dino.Elements.Filter
# Filter's the list of elements by category

Element = Input()  # "Element[]"
Category = Input()
python_script = Python(IN[0]=Element, IN[1]=Category)
# ---------- python_script.python (14 lines) ----------
import clr
import sys

sys.path.append('C:/ProgramData/Dynamo/Dynamo Revit/1.3/definitions/dino/')

from dino_core import filter_by_category

#The inputs to this node will be stored as a list in the IN variables.
elements = UnwrapElement(IN[0])
category = UnwrapElement(IN[1])


#Assign your output to the OUT variable.
OUT = filter_by_category(elements, category)
# ----------------------------------------
Element_2 = Output(python_script)  # "Element[]"
