# Dynamo custom node Filter Elements by Family and Family Symbols.dyf (Dynamo 1.3.4.6666)
# category: Dino.Elements.Filter
# Filters elements by family and family symbols

Element = Input()  # "Element[]"
Family = Input()
FamilyType = Input()
python_script = Python(IN[0]=Element, IN[1]=Family, IN[2]=FamilyType)
# ---------- python_script.python (15 lines) ----------
import clr
import sys

sys.path.append('C:/ProgramData/Dynamo/Dynamo Revit/1.3/definitions/dino/')

from dino_core import filter_elements_by_family_and_family_symbols

#The inputs to this node will be stored as a list in the IN variables.
elements = UnwrapElement(IN[0])
family = UnwrapElement(IN[1])
family_symbol = UnwrapElement(IN[2])

#Assign your output to the OUT variable.
OUT = filter_elements_by_family_and_family_symbols(elements, family, family_symbol)
      
# ----------------------------------------
Element_2 = Output(python_script)  # "Element[]"
