# Dynamo custom node Filter Elements by Parameter Equality.dyf (Dynamo 1.3.4.6666)
# category: Dino.Elements.Filter
# Filters the elements by equality of two parameter values

Element = Input()  # "Element[]"
parameterName1 = Input(parameterName1: string)
parameterName2 = Input(parameterName2: string)
isEqual = Input(isEqual: bool)
python_script = Python(IN[0]=Element, IN[1]=parameterName1, IN[2]=parameterName2, IN[3]=isEqual)
# ---------- python_script.python (16 lines) ----------
import clr
import sys

sys.path.append('C:/ProgramData/Dynamo/Dynamo Revit/1.3/definitions/dino')

from dino_core import filter_elements_by_parameter_equality

#The inputs to this node will be stored as a list in the IN variables.
elems = UnwrapElement(IN[0])
param_name1 = IN[1]
param_name2 = IN[2]
is_equal = IN[3]

#Assign your output to the OUT variable.
OUT = filter_elements_by_parameter_equality(elems, param_name1, param_name2, is_equal)
      
# ----------------------------------------
Element_2 = Output(python_script)  # "Element[]"
