# Dynamo custom node Filter Family Symbols by Family.dyf (Dynamo 1.3.4.6666)
# category: Dino.Elements.Filter
# Filters family symbols by family

Element = Input()  # "Element[]"
Family = Input()
python_script = Python(IN[0]=Element, IN[1]=Family)
# ---------- python_script.python (13 lines) ----------
import clr
import sys

sys.path.append('C:/ProgramData/Dynamo/Dynamo Revit/1.3/definitions/dino/')

from dino_core import filter_family_symbols_by_family

#The inputs to this node will be stored as a list in the IN variables.
family_symbols = UnwrapElement(IN[0])
family = UnwrapElement(IN[1])

#Assign your output to the OUT variable.
OUT = filter_family_symbols_by_family(family_symbols, family)
# ----------------------------------------
Element_2 = Output(python_script)  # "Element[]"
