# Dynamo custom node Sort Elements by Parameter of Double.dyf (Dynamo 1.3.4.6666)
# category: Dino.Elements.Sort
# Sorts the elements by parameter of type double

Element = Input()  # "Element[]"
parameter_names = Input(parameter names: string[])
python_script = Python(IN[0]=Element, IN[1]=parameter_names)
# ---------- python_script.python (13 lines) ----------
import clr
import sys

sys.path.append('C:/ProgramData/Dynamo/Dynamo Revit/1.3/definitions/dino/')

from dino_core import sort_elements_by_param_of_double

#The inputs to this node will be stored as a list in the IN variables.
elements = UnwrapElement(IN[0])
parameters = UnwrapElement(IN[1])

#Assign your output to the OUT variable.
OUT = sort_elements_by_param_of_double(elements, parameters)
# ----------------------------------------
Element_2 = Output(python_script)  # "Element[]"
