# Dynamo custom node Set Element Name.dyf (Dynamo 1.3.4.6666)
# category: Dino.Elements
# Sets the element's new name

Element = Input()  # "Element[]"
data = Input(data: var[])
python_script = Python(IN[0]=Element, IN[1]=data)
# ---------- python_script.python (14 lines) ----------
import clr
import sys

sys.path.append('C:/ProgramData/Dynamo/Dynamo Revit/1.3/definitions/dino/')

from dino_core import set_element_name

#The inputs to this node will be stored as a list in the IN variables.
elements = UnwrapElement(IN[0])
data = UnwrapElement(IN[1])

#Assign your output to the OUT variable.
OUT = set_element_name(elements, data)
      
# ----------------------------------------
void = Output(python_script)
