# Dynamo graph Collecting Elements.dyn (Dynamo 1.3.4.6666)

# group: Collecting Instances by Category
# note: Collecting elements in various ways using the built in nodes
categories = Categories("StructuralColumns")
all_elements_of_category = ElementsOfCategory(categories)

# group: Collecting Instances by Family Type
family_types = FamilyTypes("HSC-01 - Steel Hollow Section Columns:HSC-01-SHS-15 - 80.0 x 80.0 x 6.3")
all_elements_of_family_type = ElementsOfFamilyType(family_types)

# group: Collecting Elements by Level
levels = Levels("1ST STOREY")
all_elements_at_level = ElementsAtLevel(levels)

# group: Collecting Element Types: Element Types are objects under Revit API, e.g. Family, FamilySymbols, Elements etc.
element_types = ElementTypes("FamilySymbol")
all_elements_of_type = ElementsOfType(element_types)

# group: Retrieving the family by name
code_block = CodeBlock()
# ---------- code_block.designscript (5 lines) ----------
/*
 Below is an example of a family name
 that can be found in the project model.
*/
familyName = "LBSC-01 - L-Bar Steel Column";
# ----------------------------------------
byName = Family.ByName(code_block)

# group: Collecting Family Types thru a Single Family
# note: Retrieving the family types of a family
types = Family.Types(byName)

# group: Collecting the Family Instances by Family Types
# note: Retrieving the Instances by Family Type
byFamilyType = FamilyInstance.ByFamilyType(types)

# group: Collecting various element types using Dino Module
categories_2 = Categories("StructuralColumns")
# note: Collecting the Families by Category
get_families = Custom[Get Families](Category=categories_2)  # Retrieves the families by category
# note: Collecting the Family Types by Category
get_family_symbols = Custom[Get Family Symbols](Category=categories_2)  # Retrieves the family symbols by category
# note: Collecting Instances by Category
get_elements = Custom[Get Elements](Category=categories_2)  # Retrieves the elements by category
