# Dynamo graph Filtering Elements Graph.dyn (Dynamo 1.3.4.6666)

# group: Filtering Family Instances by Family and Family Type
element_types = ElementTypes("FamilyInstance")
all_elements_of_type = ElementsOfType(element_types)
code_block = CodeBlock { familyName = "LBSC-01 - L-Bar Steel Column"; familyTypeName = "LBSC-01-1 - 30.0 x 30.0 x 3.0 L-Bar Steel Column"; }
byName = Family.ByName(code_block.familyName)
byName_2 = FamilyType.ByName(code_block.familyTypeName)
filter_elements_by_family_and = Custom[Filter Elements by Family and Family Symbols](Element=all_elements_of_type, Family=byName, FamilyType=byName_2)  # Filters elements by family and family symbols

# group: Filtering Family Instances by Category
element_types_2 = ElementTypes("FamilyInstance")
all_elements_of_type_2 = ElementsOfType(element_types_2)
categories = Categories("StructuralColumns")
filter_elements_by_category = Custom[Filter Elements by Category](Element=all_elements_of_type_2, Category=categories)  # Filter's the list of elements by category

# group: Filters the elements by parameter name associated with it
element_types_3 = ElementTypes("FamilySymbol")
all_elements_of_type_3 = ElementsOfType(element_types_3)
code_block_2 = CodeBlock()
# ---------- code_block_2.designscript (6 lines) ----------
/*
 Below is an example of parameter name
 that can be found in the family
*/

parameterName = "x";
# ----------------------------------------
# note: Element is a node's parameter that accepts list of Family Symbol, Family Instances and other elements where is applicable
filter_elements_by_parameter = Custom[Filter Elements by Parameter Name](Element=all_elements_of_type_3, parameter_name=code_block_2)  # Filter's the list of element by parameter name

# group: Filters the Family Symbols by Family
element_types_4 = ElementTypes("FamilySymbol")
all_elements_of_type_4 = ElementsOfType(element_types_4)
code_block_3 = CodeBlock()
# ---------- code_block_3.designscript (6 lines) ----------
/*
 Below is an example of a family name
 that can be found in the project model.
*/

familyName = "LBSC-01 - L-Bar Steel Column";
# ----------------------------------------
byName_3 = Family.ByName(code_block_3)
filter_family_symbols_by_family = Custom[Filter Family Symbols by Family](Element=all_elements_of_type_4, Family=byName_3)  # Filters family symbols by family
