# Dynamo graph Filtering Elements by Two Parameter Values.dyn (Dynamo 1.3.4.6666)

# group: Retrieving the family types from the family
code_block = CodeBlock { "HSC-01 - Steel Hollow Section Columns"; }
byName = Family.ByName(code_block)
types = Family.Types(byName)

# group: Filtering the Family Types based on 2 given paramater values
code_block_2 = CodeBlock { "b"; "Ht"; }
# note: Please try to change to see the result
boolean = BoolSelector(true)
filter_elements_by_parameter = Custom[Filter Elements by Parameter Equality](Element=types, parameterName1=code_block_2.out0, parameterName2=code_block_2.out1, isEqual=boolean)  # Filters the elements by equality of two parameter values
