# Dynamo graph Renaming Family Types Graph.dyn (Dynamo 1.3.4.6666)

# group: 1st stage: collecting the family you can put any following description here
# note: Renaming Family Types Graph
code_block = CodeBlock { "SHS-20A - SHS Column"; }
byName = Family.ByName(code_block)
types = Family.Types(byName)

# group: stage 2: sorting the elements by size
required_parameters_name = CodeBlock { p1 = "Base"; p2 = "Depth"; p3 = "Thickness"; {p1, p2, p3}; }
sort_elements_by_parameter_of = Custom[Sort Elements by Parameter of Double](Element=types, parameter_names=required_parameters_name.out3)  # Sorts the elements by parameter of type double

# group: 3rd stage: generate data, creating new element names
numerize = Custom[Numerize](data=sort_elements_by_parameter_of)  # Generates series of numbers
code_block_2 = CodeBlock { "SHS-20A"; "-"; }
generate_keys = Custom[Generate Keys](data=numerize, key=code_block_2.out0, separator=code_block_2.out1)  # Generates a list of keys
parameterByName = Parameter.ParameterByName(element=sort_elements_by_parameter_of, name=required_parameters_name.p1)
value = Parameter.Value(parameterByName)
parameterByName_2 = Parameter.ParameterByName(element=sort_elements_by_parameter_of, name=required_parameters_name.p2)
value_2 = Parameter.Value(parameterByName_2)
code_block_3 = CodeBlock { " x "; " - "; }
join_data = Custom[Join Data](data1=value, data2=value_2, separator=code_block_3.out0)  # Concatenates the two sets of data
parameterByName_3 = Parameter.ParameterByName(element=sort_elements_by_parameter_of, name=required_parameters_name.p3)
value_3 = Parameter.Value(parameterByName_3)
join_data_2 = Custom[Join Data](data1=join_data, data2=value_3, separator=code_block_3.out0)
join_data_3 = Custom[Join Data](data1=generate_keys, data2=join_data_2, separator=code_block_3.out1)

# group: final stage: set the new name of the elements
set_element_name = Custom[Set Element Name](Element=sort_elements_by_parameter_of, data=join_data_3)  # frozen; Sets the element's new name
