# Dynamo graph Setting Parameter Values Graph.dyn (Dynamo 1.3.4.6666)

# group: Collecting the Family Types of a target Family
code_block = CodeBlock()
# ---------- code_block.designscript (6 lines) ----------
/*
 Below is an example of a family name
 that can be found inside the project model
*/

familyName = "M_Single-Flush";
# ----------------------------------------
byName = Family.ByName(code_block)
types = Family.Types(byName)

# group: Setting Parameter Value
code_block_2 = CodeBlock()
# ---------- code_block_2.designscript (3 lines) ----------
// Below is an example of a parameter name
// that can be found inside the project model
parameterName = "COBie.Type.CreatedOn";
# ----------------------------------------
parameterByName = Parameter.ParameterByName(element=types, name=code_block_2)
date = Custom[Date]()  # Generates date time data in COBie format
setValue = Parameter.SetValue(parameterByName, date)
