# Dynamo graph Sorting Elements Graph.dyn (Dynamo 1.3.4.6666)

# group: Collecting the Family Types of a target Family
code_block = CodeBlock()
# ---------- code_block.designscript (6 lines) ----------
/*
 Below is an example of a family name
 that can be found inside the project model
*/

familyName = "M_Single-Flush";
# ----------------------------------------
byName = Family.ByName(code_block)
types = Family.Types(byName)

# group: Sorting the elements by a given list of parameter names
code_block_2 = CodeBlock()
# ---------- code_block_2.designscript (14 lines) ----------
// Parameter names

param1 = "Width";
param2 = "Height";
param3 = "Thickness";

/*
 Note:
  For Dynamo 1.3 below uses curly brackets,
  For Dyname 2.0 uses square brackets for
  creating list.
*/
// [param1, param2, param3];
{param1, param2, param3};
# ----------------------------------------
# note: Note: The Element parameter of the node accepts a list of Family Symbols and Family Instances. And parameter names parameter of the node accepts up to 3 parameter names.
# Example:
# For sorting with a single parameter.
# {param1}
# For sorting with 2 parameter names
# {param1, param2}
# For sorting with 3 parameter names
# {param1, param2, param3}
sort_elements_by_parameter_of = Custom[Sort Elements by Parameter of Double](Element=types, parameter_names=code_block_2.out3)  # Sorts the elements by parameter of type double

# group: Checking the output of the parameter value of the sorted elements by param1, param2 and param3
parameterByName = Parameter.ParameterByName(element=sort_elements_by_parameter_of, name=code_block_2.param1)
value = Parameter.Value(parameterByName)
parameterByName_2 = Parameter.ParameterByName(element=sort_elements_by_parameter_of, name=code_block_2.param2)
value_2 = Parameter.Value(parameterByName_2)
parameterByName_3 = Parameter.ParameterByName(element=sort_elements_by_parameter_of, name=code_block_2.param3)
value_3 = Parameter.Value(parameterByName_3)
